# Grasshopper definition 505_wall.gh (Grasshopper 1.0.7)

crv = Curve([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])
loft = Loft(Curves=crv, Options={Adjust=False, Closed=False, LoftEnds=0, LoftSimp=0, LoftType=0, Rebuild=10, Refit=0.01})
python = GhPythonScript(surface=loft)  # -> a; inputs surface: Surface
# ---------- python: Python ----------
"""
This script must be executed in the Grasshopper Python Editor.

1. Drop a new GHPython editor component
2. Add input parameter `surface`, set type hint to `Surface` and connect any rhino surface
3. Paste this script inside the editor and run
4. To visualize results, connect `a` out parameter to a `Draw` COMPAS component

"""
import math
from compas.geometry import Box
from compas.geometry import Frame
from compas.geometry import Vector
from compas_rhino.conversions import RhinoSurface
from compas.utilities import linspace

xsize = 0.15
ysize = 0.08
zsize = 0.07
xgap = 0.0045
zgap = 0.001

surface = RhinoSurface.from_geometry(surface).to_compas()

a = []

wall_vertical_curve = surface.v_isocurve(0)
wall_height = wall_vertical_curve.length()
courses = int(math.ceil((wall_height / (zsize + zgap))))

for ri, row in enumerate(linspace(0, 1, courses)):
    _, u = wall_vertical_curve.rhino_curve.NormalizedLengthParameter(row)

    row_curve = surface.u_isocurve(u)
    row_length = row_curve.length()

    c = row_length / (xsize + xgap)
    col_count = int(math.ceil(c))
    linspaced_vector = list(linspace(0, 1, col_count))
    half_brick_offset = linspaced_vector[1] / 2

    for ci, l in enumerate(linspaced_vector):
        if ri % 2:
            l += half_brick_offset

        if ci == 0 and ri % 2 == 0:
            l += half_brick_offset / 2
        if ci == col_count - 1 and ri % 2 == 0:
            l -= half_brick_offset / 2

        fits, col = row_curve.rhino_curve.NormalizedLengthParameter(l)
        if not fits:
            break

        point = row_curve.point_at(col)
        xaxis = row_curve.tangent_at(col)
        frame = Frame(point, xaxis, xaxis.cross(Vector.Zaxis()))

        if ri % 2 == 0 and ci in (0, col_count - 1):
            brick = Box.from_diagonal([(-xsize / 4, -ysize / 2, 0), (xsize / 4, ysize / 2, -zsize)])
        else:
            brick = Box.from_diagonal([(-xsize / 2, -ysize / 2, 0), (xsize / 2, ysize / 2, -zsize)])
        brick.frame = frame
        a.append(brick)
# ---------- end python ----------
draw = GhPythonScript(cg=python)  # -> rg
# ---------- draw: Python ----------
from compas.artists import Artist

rg = Artist(cg).draw()
# ---------- end draw ----------
