# Grasshopper definition 102_assembly.ghx (Grasshopper 1.0.7)

# ----
# Viz assembly sequence
number_slider = Slider(0.17, range=0.1..2)
vec = VectorXYZ(XComponent=Slider(-0.29, range=-1..1), YComponent=Slider(0.56, range=0..1), ZComponent=Slider(0.03, range=0..1))  # -> Vector, Length
load = GhPythonScript(load=Button(), scale=number_slider, translation=vec.Vector)  # -> assembly
# ---------- load: Python ----------
import os
import sys
import compas
from compas.geometry import Scale
from compas.geometry import Transformation
from compas.geometry import Translation

canvas = ghenv.Component.OnPingDocument()
folder = os.path.dirname(canvas.FilePath)
if folder not in sys.path:
    sys.path.append(folder)

assembly = compas.json_load(os.path.join(folder, 'wall-assembly.json'))

T = Transformation()

if translation:
    T = T * Translation.from_vector(list(translation))

if scale:
    T = T * Scale.from_factors([scale] * 3)

assembly.transform(T)
# ---------- end load ----------
select_part = GhPythonScript(assembly=load, current_part_index=Slider(56, range=0..160))  # -> place_frame, a; inputs current_part_index: Int32
# ---------- select_part: Python ----------
from assembly_helpers import draw_connections
from assembly_helpers import get_assembly_sequence
from compas.artists import Artist

a = []
a += draw_connections(assembly)

for block in assembly.blocks():
    a.append(Artist(block.frame(block.top())).draw())

sequence = get_assembly_sequence(assembly)

for i in range(current_part_index):
    node = sequence[i]
    block = assembly.node_block(node)
    if (current_part_index-1) == i:
        place_frame = block.frame(block.top())

    a += [Artist(block).draw()]
# ---------- end select_part ----------
