# Grasshopper definition 103_assembly.ghx (Grasshopper 1.0.7)

# ----
# Plan assembly
number_slider = Slider(0.17, range=0.1..2)
vec = VectorXYZ(XComponent=Slider(-0.29, range=-1..1), YComponent=Slider(0.56, range=0..1), ZComponent=Slider(0.03, range=0..1))  # -> Vector, Length
load = GhPythonScript(load=Button(), scale=number_slider, translation=vec.Vector)  # -> assembly
# ---------- load: Python ----------
import os
import sys
import compas
from compas.geometry import Scale
from compas.geometry import Transformation
from compas.geometry import Translation

canvas = ghenv.Component.OnPingDocument()
folder = os.path.dirname(canvas.FilePath)
if folder not in sys.path:
    sys.path.append(folder)

assembly = compas.json_load(os.path.join(folder, 'wall-assembly.json'))

T = Transformation()

if translation:
    T = T * Translation.from_vector(list(translation))

if scale:
    T = T * Scale.from_factors([scale] * 3)

assembly.transform(T)
# ---------- end load ----------
select_part = GhPythonScript(assembly=load, current_part_index=Slider(102, range=0..160))  # -> place_frame, a; inputs current_part_index: Int32
# ---------- select_part: Python ----------
from assembly_helpers import draw_connections
from assembly_helpers import get_assembly_sequence
from compas.artists import Artist

a = []
a += draw_connections(assembly)

for block in assembly.blocks():
    a.append(Artist(block.frame(block.top())).draw())

sequence = get_assembly_sequence(assembly)

for i in range(current_part_index):
    node = sequence[i]
    block = assembly.node_block(node)
    if (current_part_index-1) == i:
        place_frame = block.frame(block.top()).copy()
        place_frame.xaxis *= -1

    a += [Artist(block).draw()]
# ---------- end select_part ----------

# ----
# Robotic planning
button = Button()
ur10e = GhPythonScript(load=button)  # -> robot
# ---------- ur10e: Python ----------
import os

import compas_fab
from compas.artists import Artist
from compas.geometry import Frame
from compas.robots import RobotModel
from compas.robots.resources import LocalPackageMeshLoader
from compas_fab.backends import AnalyticalInverseKinematics
from compas_fab.backends import OffsetWristKinematics
from compas_fab.backends.interfaces import ClientInterface
from compas_fab.robots import Robot
from compas_fab.robots import RobotSemantics


canvas = ghenv.Component.OnPingDocument()

urdf_folder = os.path.join(os.path.dirname(canvas.FilePath), '../../data/robots')
urdf_file = os.path.join(urdf_folder, 'ur10e.urdf')
srdf_file = os.path.join(urdf_folder, 'ur10e.srdf')

model = RobotModel.from_urdf_file(urdf_file)
model.load_geometry(LocalPackageMeshLoader(urdf_folder, 'ur_description'))

semantics = RobotSemantics.from_srdf_file(srdf_file, model)

client = ClientInterface()
client.is_connected = True
client.inverse_kinematics = AnalyticalInverseKinematics(solver='ur10e')

robot = Robot(model, client=client, semantics=semantics)
robot.artist = Artist(model)
# ---------- end ur10e ----------
pt = ConstructPoint(XCoordinate=Slider(0, range=0..1), YCoordinate=Slider(0, range=0..1), ZCoordinate=Slider(0, range=0..1))
tool_frame = ToolFrame(O=pt, C=pt)
mesh = Mesh(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)
panel = Panel("1. Attach tool")
pt_2 = Point(Point(-0.3411376823, 0.6627660137, 0.06882013759))
pick_frame = PickFrame(O=pt_2)
number_slider_2 = Slider(0, range=0..10)
panel_2 = Panel("2. Solve IK")
panel_3 = Panel("3. Visualize")

# ==== cluster PickFrame
O = ClusterInput()
xy = XYPlane(Origin=O)
pflip = FlipPlane(Plane=xy, ReverseX=False, ReverseY=False, SwapAxes=True)
pi = Pi(Factor=0.5)
prot = RotatePlane(Plane=pflip, Angle=pi)
P = ClusterOutput(prot)

# ==== cluster ToolFrame
O = ClusterInput()
pi = Pi(Factor=0.5)
Y = UnitY(Factor=1)
xy = XYPlane(Origin=O)
C = ClusterInput()
rot3d = Rotate3D(Geometry=xy, Angle=pi, Center=C, Axis=Y)  # -> Geometry, Transform
G = ClusterOutput(rot3d.Geometry)
