# Grasshopper definition 104_assembly.ghx (Grasshopper 1.0.7)

# ----
# Plan assembly
number_slider = Slider(0.17, range=0.1..2)
vec = VectorXYZ(XComponent=Slider(-0.29, range=-1..1), YComponent=Slider(0.56, range=0..1), ZComponent=Slider(0.03, range=0..1))  # -> Vector, Length
load = GhPythonScript(load=Button(), scale=number_slider, translation=vec.Vector)  # -> assembly
# ---------- load: Python ----------
import os
import sys
import compas
from compas.geometry import Scale
from compas.geometry import Transformation
from compas.geometry import Translation

canvas = ghenv.Component.OnPingDocument()
folder = os.path.dirname(canvas.FilePath)
if folder not in sys.path:
    sys.path.append(folder)

assembly = compas.json_load(os.path.join(folder, 'wall-assembly.json'))

T = Transformation()

if translation:
    T = T * Translation.from_vector(list(translation))

if scale:
    T = T * Scale.from_factors([scale] * 3)

assembly.transform(T)
# ---------- end load ----------
select_part = GhPythonScript(assembly=load, current_part_index=Slider(49, range=0..160))  # -> place_frame, a; inputs current_part_index: Int32
# ---------- select_part: Python ----------
from assembly_helpers import draw_connections
from assembly_helpers import get_assembly_sequence
from compas.artists import Artist

a = []
a += draw_connections(assembly)

for block in assembly.blocks():
    a.append(Artist(block.frame(block.top())).draw())

sequence = get_assembly_sequence(assembly)

for i in range(current_part_index):
    node = sequence[i]
    block = assembly.node_block(node)
    if (current_part_index-1) == i:
        place_frame = block.frame(block.top()).copy()
        place_frame.xaxis *= -1

    a += [Artist(block).draw()]
# ---------- end select_part ----------

# ----
# Robotic planning
button = Button()
ur10e = GhPythonScript(load=button)  # -> robot
# ---------- ur10e: Python ----------
import os

import compas_fab
from compas.artists import Artist
from compas.geometry import Frame
from compas.robots import RobotModel
from compas.robots.resources import LocalPackageMeshLoader
from compas_fab.backends import AnalyticalInverseKinematics
from compas_fab.backends import OffsetWristKinematics
from compas_fab.backends.interfaces import ClientInterface
from compas_fab.robots import Robot
from compas_fab.robots import RobotSemantics


canvas = ghenv.Component.OnPingDocument()

urdf_folder = os.path.join(os.path.dirname(canvas.FilePath), '../../data/robots')
urdf_file = os.path.join(urdf_folder, 'ur10e.urdf')
srdf_file = os.path.join(urdf_folder, 'ur10e.srdf')

model = RobotModel.from_urdf_file(urdf_file)
model.load_geometry(LocalPackageMeshLoader(urdf_folder, 'ur_description'))

semantics = RobotSemantics.from_srdf_file(srdf_file, model)

client = ClientInterface()
client.is_connected = True
client.inverse_kinematics = AnalyticalInverseKinematics(solver='ur10e')

robot = Robot(model, client=client, semantics=semantics)
robot.artist = Artist(model)
# ---------- end ur10e ----------
pt = ConstructPoint(XCoordinate=Slider(0.1, range=0..1), YCoordinate=Slider(0, range=0..1), ZCoordinate=Slider(0, range=0..1))
tool_frame = ToolFrame(O=pt, C=pt)
mesh = Mesh(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)
tool = COMPASFABAttachedTool(robot=ur10e, visual_mesh=mesh, tcf_plane=tool_frame)  # -> robot; inputs visual_mesh: Mesh, collision_mesh: Mesh
#   port visual_mesh: A visual mesh for the tool.
#   port collision_mesh: A collision mesh for the tool.
#   port tcf_plane: The frame of the tool in tool0 frame.
#   port group: The planning group to which the tool should be attached.
# ---------- tool: Python ----------
"""
Attach a tool to the robot.

COMPAS FAB v0.26.0
"""
from ghpythonlib.componentbase import executingcomponent as component
from compas_rhino.conversions import RhinoMesh
from compas_rhino.conversions import plane_to_compas_frame

from compas.geometry import Frame
from compas_fab.robots import Tool


class AttachToolComponent(component):
    def RunScript(self, robot, visual_mesh, collision_mesh, tcf_plane, group):
        if robot and robot.client and robot.client.is_connected and visual_mesh:
            if not collision_mesh:
                collision_mesh = visual_mesh

            c_visual_mesh = RhinoMesh.from_geometry(visual_mesh).to_compas()
            c_collision_mesh = RhinoMesh.from_geometry(collision_mesh).to_compas()

            if not tcf_plane:
                frame = Frame.worldXY()
            else:
                frame = plane_to_compas_frame(tcf_plane)
            tool = Tool(c_visual_mesh, frame, c_collision_mesh)

            robot.attach_tool(tool, group)

        return robot
# ---------- end tool ----------
pt_2 = Point(Point(-0.5628494634, 0.3356618008, 0.06882013759))
pick_frame = PickFrame(O=pt_2)
planning = GhPythonScript(robot=tool, place_frame=select_part.place_frame, pick_frame=pick_frame, x=Slider(0, range=0..10))  # -> config; inputs x: Int32
# ---------- planning: Python ----------
from compas_rhino.conversions import RhinoPlane

SAFE_Z_OFFSET = 0.1

if robot and robot.client:
    start_configuration = robot.zero_configuration()
    place_configs = robot.iter_inverse_kinematics(place_frame, start_configuration, options={'keep_order': True})
    place_config = list(place_configs)[2]

    safe_place_frame = place_frame.copy()
    safe_place_frame.point.z += SAFE_Z_OFFSET
    
    safe_place_configs = robot.iter_inverse_kinematics(safe_place_frame, place_config, options={'keep_order': True})
    safe_place_config = list(safe_place_configs)[2]
    
    pick_frame = RhinoPlane.from_geometry(pick_frame).to_compas_frame()
    pick_configs = robot.iter_inverse_kinematics(pick_frame, start_configuration, options={'keep_order': True})
    pick_config = list(pick_configs)[2]

    safe_pick_frame = pick_frame.copy()
    safe_pick_frame.point.z += SAFE_Z_OFFSET

    safe_pick_configs = robot.iter_inverse_kinematics(safe_pick_frame, start_configuration, options={'keep_order': True})
    safe_pick_config = list(safe_pick_configs)[2]
    
    configs = [safe_pick_config, pick_config, safe_pick_config, safe_place_config, place_config, safe_place_config]

config = configs[x]
# ---------- end planning ----------
toggle = BooleanToggle(False)
robot_visualize = COMPASFABRobotVisualize(robot=tool, configuration=planning, show_cm=toggle, show_acm=toggle)  # -> visual, collision, collision_meshes, attached_meshes, frames, base_frame, ee_frame; inputs show_visual: Boolean, show_collision: Boolean, show_frames: Boolean, show_base_frame: Boolean, show_end_effector_frame: Boolean, show_cm: Boolean, show_acm: Boolean
#   port group: The planning group used for end-effector and base visualization.
#   port configuration: The robot's full configuration.
#   port show_visual: Whether or not to show the robot's visual meshes.
#   port show_collision: Whether or not to show the robot's collision meshes.
#   port show_frames: Whether or not to show the robot's joint frames.
#   port show_base_frame: Whether or not to show the robot's base frame.
#   port show_end_effector_frame: Whether or not to show the robot's end-effector frame.
#   port show_cm: Whether or not to show the collision meshes (if any).
#   port show_acm: Whether or not to show the attached collision meshes (if any).
#   port visual: Rhino meshes of the robot's visual geometry (if any).
#   port collision: Rhino meshes of the robot's collision geometry (if any).
#   port collision_meshes: Rhino meshes of the scene's collision meshes (if any).
#   port attached_meshes: Rhino meshes of the scene's attached collision meshes (if any).
#   port frames: The robot's joint frames as Rhino planes (if any).
#   port base_frame: The robot's base frame as a Rhino plane (if any).
#   port ee_frame: The robot's end-effector frame as a Rhino plane (if any).
# ---------- robot_visualize: Python ----------
"""
Visualizes the robot.

COMPAS FAB v0.27.0
"""
from compas.artists import Artist
from compas.geometry import Frame
from compas.geometry import Transformation
from compas_fab.robots import PlanningScene
from ghpythonlib.componentbase import executingcomponent as component


class RobotVisualize(component):
    def RunScript(
        self,
        robot,
        group,
        configuration,
        show_visual,
        show_collision,
        show_frames,
        show_base_frame,
        show_end_effector_frame,
        show_cm,
        show_acm,
    ):

        visual = None
        collision = None
        collision_meshes = None
        attached_meshes = None
        frames = None
        base_frame = None
        ee_frame = None

        if robot:
            show_visual = True if show_visual is None else show_visual
            show_cm = True if show_cm is None else show_cm
            show_acm = True if show_acm is None else show_acm
            configuration = configuration or robot.zero_configuration()

            robot.update(configuration, visual=show_visual, collision=show_collision)
            compas_frames = robot.transformed_frames(configuration, group)

            if show_visual:
                visual = robot.artist.draw_visual()

            if show_collision:
                collision = robot.artist.draw_collision()

            if show_base_frame:
                base_compas_frame = compas_frames[0]
                artist = Artist(base_compas_frame)
                base_frame = artist.draw()

            if show_end_effector_frame:
                ee_compas_frame = robot.forward_kinematics(
                    configuration, group, options=dict(solver="model")
                )
                artist = Artist(ee_compas_frame)
                ee_frame = artist.draw()

            if show_frames:
                frames = []
                for compas_frame in compas_frames[1:]:
                    artist = Artist(compas_frame)
                    frame = artist.draw()
                    frames.append(frame)

            if show_cm or show_acm:
                scene = PlanningScene(robot)
                scene = robot.client.get_planning_scene()

                collision_meshes = []
                attached_meshes = []

                if show_cm:
                    for co in scene.world.collision_objects:
                        header = co.header
                        frame_id = header.frame_id
                        cms = co.to_collision_meshes()

                        for cm in cms:
                            if cm.frame != Frame.worldXY():
                                t = Transformation.from_frame(cm.frame)
                                mesh = cm.mesh.transformed(t)
                            else:
                                mesh = cm.mesh

                            collision_meshes.append(Artist(mesh).draw())

                if show_acm:
                    for aco in scene.robot_state.attached_collision_objects:
                        for acm in aco.to_attached_collision_meshes():
                            frame_id = aco.object["header"]["frame_id"]
                            frame = robot.forward_kinematics(
                                configuration, options=dict(link=frame_id)
                            )
                            t = Transformation.from_frame(frame)

                            # Local CM frame
                            if (
                                acm.collision_mesh.frame
                                and acm.collision_mesh.frame != Frame.worldXY()
                            ):
                                t = t * Transformation.from_frame(
                                    acm.collision_mesh.frame
                                )

                            mesh = acm.collision_mesh.mesh.transformed(t)

                            attached_meshes.append(Artist(mesh).draw())

        return (
            visual,
            collision,
            collision_meshes,
            attached_meshes,
            frames,
            base_frame,
            ee_frame,
        )
# ---------- end robot_visualize ----------

# ==== cluster PickFrame
O = ClusterInput()
xy = XYPlane(Origin=O)
pflip = FlipPlane(Plane=xy, ReverseX=False, ReverseY=False, SwapAxes=True)
pi = Pi(Factor=0.5)
prot = RotatePlane(Plane=pflip, Angle=pi)
P = ClusterOutput(prot)

# ==== cluster ToolFrame
O = ClusterInput()
pi = Pi(Factor=0.5)
Y = UnitY(Factor=1)
xy = XYPlane(Origin=O)
C = ClusterInput()
rot3d = Rotate3D(Geometry=xy, Angle=pi, Center=C, Axis=Y)  # -> Geometry, Transform
G = ClusterOutput(rot3d.Geometry)
